# Grasshopper definition Revit_All_to_Rhino.gh (Grasshopper 1.0.7)
# plug-ins: Rhino.Inside for Autodesk Revit, LunchBox, Human, EleFront

active_graphical_view = ActiveGraphicalView()
selectable_in_view_filter = SelectableInViewFilter(View=active_graphical_view, Inverted=False)
colour_swatch = ColourSwatch(SwatchColor=RGB(0, 255, 242))
query_elements = QueryElements(Filter=selectable_in_view_filter)  # -> Elements, Count
create_layers = CreateLayers(CreateToggle=Button(), LayerNames="Revit_Geom", LayerColors=colour_swatch)
create_modify_layers = CreateModifyLayers(LayerName="Revit_Geom", LayerColor=colour_swatch, DeleteLayer=False, enableFullPath=False)  # -> LayerNames, LayerFullPath
element_geometry = ElementGeometry(Elements=query_elements.Elements)  # -> flatten(Geometry)
define_layer = DefineLayer(Name=create_modify_layers.LayerNames)
define_object_attributes = DefineObjectAttributes(Layer=create_modify_layers.LayerNames, Color=colour_swatch)
panel = Panel(element_geometry)
bake_geometry = BakeGeometry(Bake=Button(), Geometry=element_geometry, Attributes=define_object_attributes, DeleteOldBakes=False, PreserveTrees=False)
