# Grasshopper definition parametric-extrusion-arr-from-crvs.gh (Grasshopper 1.0.7)

# ----
# Set Count
number_slider = Slider(35, range=0..100)

# ----
# Extrusion Width
number_slider_2 = Slider(0.75, range=0..1)

# ----
# Extrusion Depth
number_slider_3 = Slider(1.5, range=0..10)

# ----
# Set Path Curve
curve = Curve(<curve referenced from the Rhino model>)

# ----
# Set Multiple Curves for Profile
curve_2 = Curve([<curve referenced from the Rhino model> x3])

join_curves = JoinCurves(Curves=curve_2, Preserve=False)
flip_curve = FlipCurve(Curve=join_curves)  # -> Curve, Flag
xy_plane = XYPlane(Origin=Point(0, 0, 0))
offset_curve = OffsetCurve(Curve=join_curves, Distance=number_slider_2, Plane=xy_plane, Corners=1)  # -> flatten(Curve)
loft = Loft(
    Curves=flatten([offset_curve, join_curves]),
    Options={Adjust=False, Closed=False, LoftEnds=0, LoftSimp=0, LoftType=0, Rebuild=10, Refit=0.01})
unit_z = UnitZ(Factor=number_slider_3)
extrude = Extrude(Base=loft, Direction=unit_z)
curve_array = CurveArray(Geometry=extrude, Curve=curve, Count=number_slider)  # -> Geometry, Transform
list_item = ListItem(List=curve_array.Geometry, Index="1", Wrap=True)
list_item_2 = ListItem(List=curve_array.Geometry, Index="0", Wrap=True)
area = Area(Geometry=list_item)  # -> Area, Centroid
area_2 = Area(Geometry=list_item_2)  # -> Area, Centroid
distance = Distance(PointA=area.Centroid, PointB=area_2.Centroid)

# ----
# Spacing(Report Only)
panel = Panel(distance)
